# Dynamo graph 01_Revit para Robot_2027.dyn "Revit para Robot" (Dynamo 4.1.1.5050)
# Envia a estrutura do Revit 2027 para o Robot 2027, aplica peso proprio e sobrecarga, calcula e le as reacoes.
# packages: CivilConnection2027 7.0.0

# note: CivilConnection 2027 - Revit para Robot
civilconnection_robot = CodeBlock()
# ---------- civilconnection_robot.designscript (27 lines) ----------
// PARAMETROS (abra o Robot com um projeto qualquer antes de executar)
// usarAnalitico = true usa o modelo analitico (recomendado: barras conectadas nos nos)
usarAnalitico = true;
calcular = true;
// sobrecarga nas lajes em Pa (N/m2), negativa = para baixo
cargaLaje = -3000;
// apoio engastado nos nos ate esta distancia (m) acima do no mais baixo
toleranciaApoio = 0.01;
// FLUXO
robot = CivilConnection.Robot.RobotModel.Connect(true, "Shell", -1, null);
elementos = usarAnalitico ? CivilConnection.Robot.RobotModel.RevitAnalyticalElements(true, true) : CivilConnection.Robot.RobotModel.RevitStructuralElements(true, true, true, false);
envio = robot.FromRevitAnalytical(elementos, "", 0.5, 0.5);
engaste = robot.CreateSupport("ENGASTE", true, true, true, true, true, true);
apoios = robot.AssignSupportToLowestNodes(engaste, toleranciaApoio, envio);
limpar = robot.DeleteAllCases(apoios);
casoG = robot.CreateLoadCase(1, "G - peso proprio", "Permanent", limpar);
pp = robot.AddSelfWeight(casoG, 1);
casoQ = robot.CreateLoadCase(2, "Q - sobrecarga", "Exploatation", pp);
sobrecarga = robot.AddPanelUniformLoads(casoQ, envio["Panels"], 0, 0, cargaLaje, false);
elu = robot.CreateCombination(3, "ELU 1.4G + 1.4Q", [pp, sobrecarga], [1.4, 1.4], "ULS");
malha = robot.GenerateMesh(elu);
calculado = robot.Calculate(calcular, malha);
reacoesG = robot.NodeReactions(apoios, pp, calculado);
pesoProprio_kN = Math.Sum(reacoesG["FZ"]) / 1000;
reacoesELU = robot.NodeReactions(apoios, elu, calculado);
somaFZ_ELU_kN = Math.Sum(reacoesELU["FZ"]) / 1000;
fim = robot.EndSession(somaFZ_ELU_kN);
# ----------------------------------------
watch_envio = Watch(civilconnection_robot.envio)
watch_pesoproprio_kn = Watch(civilconnection_robot.pesoProprio_kN)
watch_somafz_elu_kn = Watch(civilconnection_robot.somaFZ_ELU_kN)
